# Grasshopper definition AssignTags.gh (Grasshopper 0.9.76)
# plug-ins: BH.UI.Grasshopper

# ----
# Adapter
path = FilePath()
bhom = BHoMObject()

bhom_2 = BHoMObject([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])

# ----
# Assign Tags
panel = Panel("""Steel Elements
Group_1
Test_Group""")
txt = Text(panel)
propertyvalue = PropertyValue(Obj=bhom_2, PropName="Tags", Value=txt, Component="{ .PropertyValue")

# ----
# Push
toggle = BooleanToggle(False)
bhom_3 = BHoMObject(propertyvalue)
push = Push(Adapter=bhom, Objects=bhom_3, Active=toggle, Component="{ .Push")  # -> Objects, Success
