# Grasshopper definition CreateBarTemperatureLoad.gh (Grasshopper 0.9.76)
# plug-ins: BH.UI.Grasshopper

# ----
# Adapter
path = FilePath()
bhom = BHoMObject()

# ----
# Create Loadcase
panel = Panel("Loadcase1")
loadcase = Loadcase(
    Name=panel,
    Number=Slider(1, range=0..10),
    Nature="{ \"_t\" : \"System.Enum\", \"TypeName\" : { \"_t\" : \"System.Type\", \"Name\" : \"BH.oM.Structure.Loads.LoadNature\" }, \"Value\" : \"Other\" }",
    Component="{ .Loadcase")

# ----
# Push
bhom_2 = BHoMObject([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])
push = Push(Adapter=bhom, Objects=bhom_2, Active=Toggle(False), Component="{ .Push")  # -> Objects, Success

bhom_3 = BHoMObject(push.Objects)
bhom_4 = BHoMObject(loadcase)

# ----
# Create BHoM Load
number_slider = Slider(10, range=0..10)
bartemperatureload = BarTemperatureLoad(
    Loadcase=bhom_4,
    TemperatureChange=number_slider,
    Objects=bhom_3,
    Axis="{ \"_t\" : \"System.Enum\", \"TypeName\" : { \"_t\" : \"System.Type\", \"Name\" : \"BH.oM.Structure.Loads.LoadAxis\" }, \"Value\" : \"Global\" }",
    Projected=False,
    Name="Bar Temp Load",
    Component="{ .BarTemperatureLoad")

# ----
# Push
bhom_5 = BHoMObject(bartemperatureload)
push_2 = Push(Adapter=bhom, Objects=bhom_5, Active=push.Success, Component="{ .Push")  # -> Objects, Success
