# Grasshopper definition CreateBarUniformlyDistributedLoads.gh (Grasshopper 0.9.76)
# plug-ins: BH.UI.Grasshopper

# ----
# Adapter
path = FilePath()
bhom = BHoMObject()

# ----
# Create Loadcase
number_slider = Slider(1, range=0..10)
loadcase = Loadcase(
    Name="Loadcase1",
    Number=number_slider,
    Nature="{ \"_t\" : \"System.Enum\", \"TypeName\" : { \"_t\" : \"System.Type\", \"Name\" : \"BH.oM.Structure.Loads.LoadNature\" }, \"Value\" : \"Other\" }",
    Component="{ .Loadcase")

bhom_2 = BHoMObject([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])

# ----
# Push
toggle = BooleanToggle(False)
push = Push(Adapter=bhom, Objects=bhom_2, Active=toggle)  # -> Objects, Success

bool = Boolean(push.Success)

# ----
# Create UniformlyDistributedBarLoad
number_slider_2 = Slider(8, range=0..10)
vec = VectorXYZ(XComponent=Slider(2, range=0..10), YComponent=Slider(6, range=0..10), ZComponent=number_slider_2)  # -> Vector, Length
vec_2 = VectorXYZ(XComponent=Slider(5, range=0..10), YComponent=Slider(2, range=0..10), ZComponent=Slider(9, range=0..10))  # -> Vector, Length
loadaxis = LoadAxis(
    {"Global": 0, "Local": 1}, selected="Global",
    TypeName="BH.oM.Structure.Loads.LoadAxis, Structure_oM, Version=2.0.0.0, Culture=neutral, PublicKeyToken=null")
bhom_3 = BHoMObject(loadcase)
bhom_4 = BHoMObject(push.Objects)
vec_3 = Vector(vec.Vector)
vec_4 = Vector(vec_2.Vector)
baruniformlydistributedload = BarUniformlyDistributedLoad(
    Loadcase=bhom_3,
    Objects=bhom_4,
    Force=vec_3,
    Moment=vec_4,
    Axis=loadaxis,
    Projected=False,
    Name="UniformlyDistributed",
    Component="{ .BarUniformlyDistributedLoad")

# ----
# Push
bhom_5 = BHoMObject(baruniformlydistributedload)
push_2 = Push(Adapter=bhom, Objects=bhom_5, Active=bool)  # -> Objects, Success
