# Grasshopper definition CreateBarVaryingDistributedLoads.gh (Grasshopper 0.9.76)
# plug-ins: BH.UI.Grasshopper

# ----
# Adapter
path = FilePath()
bhom = BHoMObject()

# ----
# Create Loadcase
panel = Panel("Loadcase1")
loadcase = Loadcase(
    Name=panel,
    Number=Slider(1, range=0..10),
    Nature="{ \"_t\" : \"System.Enum\", \"TypeName\" : { \"_t\" : \"System.Type\", \"Name\" : \"BH.oM.Structure.Loads.LoadNature\" }, \"Value\" : \"Other\" }",
    Component="{ .Loadcase")

# ----
# Push
toggle = BooleanToggle(False)
bhom_2 = BHoMObject([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])
push = Push(Adapter=bhom, Objects=bhom_2, Active=toggle)  # -> Objects, Success

# ----
# CreateBarVaryingDistributed
number_slider = Slider(0, range=0..10)
vec = VectorXYZ(XComponent=Slider(0, range=0..10), YComponent=Slider(0, range=0..10), ZComponent=Slider(0, range=0..10))  # -> Vector, Length
vec_2 = VectorXYZ(XComponent=Slider(0, range=0..10), YComponent=Slider(0, range=0..10), ZComponent=Slider(0, range=0..10))  # -> Vector, Length
vec_3 = VectorXYZ(XComponent=Slider(0, range=0..10), YComponent=Slider(0, range=0..10), ZComponent=Slider(0, range=0..10))  # -> Vector, Length
vec_4 = VectorXYZ(XComponent=Slider(0, range=0..10), YComponent=number_slider, ZComponent=Slider(0, range=0..10))  # -> Vector, Length
vec_5 = Vector(vec.Vector)
vec_6 = Vector(vec_4.Vector)
vec_7 = Vector(vec_2.Vector)
vec_8 = Vector(vec_3.Vector)
loadaxis = LoadAxis(
    {"Global": 0, "Local": 1}, selected="Global",
    Component="{ \"_t\" : \"System.Type\", \"Name\" : \"BH.oM.Structure.Loads.LoadAxis\" }",
    Selection=0)
barvaryingdistributedload = BarVaryingDistributedLoad(
    Loadcase=loadcase,
    Objects=push.Objects,
    DistFromA=Slider(0, range=0..1),
    ForceA=vec_6,
    MomentA=vec_5,
    DistFromB=Slider(0, range=0..1),
    ForceB=vec_7,
    MomentB=vec_8,
    Axis=loadaxis,
    Projected=False,
    Name="Bar Varying Distributed Load",
    Component="{ .BarVaryingDistributedLoad")

# ----
# Push
bhom_3 = BHoMObject(barvaryingdistributedload)
push_2 = Push(Adapter=bhom, Objects=bhom_3, Active=push.Success)  # -> Objects, Success
