# Grasshopper definition CreateGravityLoads.gh (Grasshopper 0.9.76)
# plug-ins: Alligator

# ----
# Create Adapter Here
# File Path to reference model file
# Plug structural adapter in to this component.
path = FilePath("C:\Users\pnugent\Desktop\wgsdgh.mdl")

bhom = BHoMObject()
bhom_2 = BHoMObject(flatten(Tree({0}: [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], {0;0}: [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])))
push = Push(Adapter=bhom, Objects=bhom_2, Active=Toggle(False), Component="{ .Push")  # -> Objects, Success
loadcase = Loadcase(
    Name="Loadcase1",
    Number=Slider(1, range=0..10),
    Nature="{ \"_t\" : \"System.Enum\", \"TypeName\" : { \"_t\" : \"System.Type\", \"Name\" : \"BH.oM.Structure.Loads.LoadNature\" }, \"Value\" : \"Other\" }",
    Component="{ .Loadcase")
bhom_3 = BHoMObject(loadcase)

# ----
# CreateGravityLoad
number_slider = Slider(-1, range=-1..1)
vec = VectorXYZ(XComponent=0, YComponent=0, ZComponent=number_slider)  # -> Vector, Length

vec_2 = Vector(vec.Vector)

gravityload = GravityLoad(Loadcase=bhom_3, Direction=vec_2, Objects=push.Objects, Name="GravityLoad", Component="{ .GravityLoad")

bhom_4 = BHoMObject(gravityload)
push_2 = Push(Adapter=bhom, Objects=bhom_4, Active=push.Success, Component="{ .Push")  # -> Objects, Success
