# Grasshopper definition CreatePointDisplacement.gh (Grasshopper 0.9.76)
# plug-ins: BH.UI.Grasshopper

# ----
# Adapter
path = FilePath()
bhom = BHoMObject()

# ----
# Create Loadcase
panel = Panel("Loadcase1")
loadcase = Loadcase(
    Name=panel,
    Number=Slider(1, range=0..10),
    Nature="{ \"_t\" : \"System.Enum\", \"TypeName\" : { \"_t\" : \"System.Type\", \"Name\" : \"BH.oM.Structure.Loads.LoadNature\" }, \"Value\" : \"Other\" }",
    Component="{ .Loadcase")

# ----
# Push
toggle = BooleanToggle(False)
bhom_2 = BHoMObject([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])
push = Push(Adapter=bhom, Objects=bhom_2, Active=toggle, Component="{ .Push")  # -> Objects, Success

bhom_3 = BHoMObject(push.Objects)
bhom_4 = BHoMObject(loadcase)

# ----
# Create BHoM Load
number_slider = Slider(4.99, range=0..20)
vec = VectorXYZ(XComponent=Slider(9.6, range=0..20), YComponent=Slider(8.45, range=0..20), ZComponent=Slider(7.68, range=0..20))  # -> Vector, Length
vec_2 = VectorXYZ(XComponent=number_slider, YComponent=Slider(15.23, range=0..20), ZComponent=Slider(0, range=0..20))  # -> Vector, Length
pointdisplacement = PointDisplacement(
    Loadcase=bhom_4,
    Objects=bhom_3,
    Translation=vec_2.Vector,
    Rotation=vec.Vector,
    Axis="{ \"_t\" : \"System.Enum\", \"TypeName\" : { \"_t\" : \"System.Type\", \"Name\" : \"BH.oM.Structure.Loads.LoadAxis\" }, \"Value\" : \"Global\" }",
    Name="Point Displacement",
    Component="{ .PointDisplacement")

# ----
# Push
bhom_5 = BHoMObject(pointdisplacement)
push_2 = Push(Adapter=bhom, Objects=bhom_5, Active=push.Success, Component="{ .Push")  # -> Objects, Success
